vi "time2.gvi"   [LabVIEW NXG 3.1.0]
inputs:
  "十进制整型字符串": string
outputs:
  "输出": string
diagram:
  String Length(string=$"十进制整型字符串") -> (length=w1)
  case (w1) {
    frame 2, Default {
      w2 = $"十进制整型字符串"
    }
    frame 1 {
      Concatenate Strings("0", $"十进制整型字符串") -> w2
    }
  }
  $"输出" <- w2
