vi "函数.gvi"   [LabVIEW NXG 3.1.0]
panel controls:
  "图像按钮": bool
panel indicators:
  "数值": i32
  "循环计数": i32
diagram:
  timed loop (iteration -> i1) {
    $"数值" <- i1
    Left Timing Source Border Node[AlarmName=L, DefaultTimingSourceName="1 kHz", DefaultTimingSourceType=1](period_in=1000)
    Left Timing Error Border Node()
    Right Timing Error Border Node()
    Property Node(instance in=reference to "图像按钮") -> ("KeyFocus"=w1)
    Left Timing Statistics Border Node()
    Left Execution System Border Node()
    stop if w1
  }
  timed loop (iteration -> i2) {
    Property Node(instance in=reference to "图像按钮") -> ("KeyFocus"=w2)
    Left Timing Source Border Node[AlarmName=L, DefaultTimingSourceName="1 kHz", DefaultTimingSourceType=1](period_in=2000)
    Left Timing Statistics Border Node()
    Left Execution System Border Node()
    Left Timing Error Border Node()
    $"循环计数" <- i2
    Right Timing Error Border Node()
    stop if w2
  }
