vi "DateAndTime.gvi"   [LabVIEW NXG 3.1.0]
inputs:
  "Error In": error
outputs:
  "Error Out": error
  "Time": string
  "Date": string
uses:
  Dashboard::time2.gvi
diagram:
  sequence {
    frame 0 {
      Get Current Time() -> (current time=w1)
      Timestamp To Date Time(time stamp=w1) -> (date time rec=w2)
      Property Node(instance in=w2) -> ("minute"=w3, "hour"=w4, "day of month"=w5, "month"=w6, "year"=w7, "day of week"=w8)
      sequence {
        frame 0 {
          # Day
          Number To Decimal String(number=w5, width (-)=2) -> (decimal integer string=w9)
        }
      }
      sequence {
        frame 0 {
          Build Array("Dec", "Jan", "Feb", "Mar", "Apr", "May", "Jun", "Jul", "Aug", "Sep", "Oct", "Nov") -> w10
          Quotient And Remainder(x=w6, y=12) -> (x-y*floor(x/y)=w11)
          # Month
          Array Index(array=w10) -> (out0[w11]=w12)
        }
      }
      sequence {
        frame 0 {
          # Year
          Number To Decimal String(number=w7) -> (decimal integer string=w13)
        }
      }
      sequence {
        frame 0 {
          Concatenate Strings(w9, " ", w12, " ", w13) -> w14
          # Date
          $Date <- w14
        }
      }
      sequence {
        frame 0 {
          Build Array("Sun", "Mon", "Tue", "Wed", "Thu", "Fri", "Sat") -> w15
          Decrement(x=w8) -> w16
          Quotient And Remainder(x=w16, y=7) -> (x-y*floor(x/y)=w17)
          # Day of Week
          Array Index(array=w15) -> (out0[w17]=w18)
        }
      }
      sequence {
        frame 0 {
          Number To Decimal String(number=w4) -> (decimal integer string=w19)
          # Hour
          call "time2.gvi"(十进制整型字符串=w19) -> (输出=w20)
        }
      }
      sequence {
        frame 0 {
          Number To Decimal String(number=w3) -> (decimal integer string=w21)
          # Minute
          call "time2.gvi"(十进制整型字符串=w21) -> (输出=w22)
        }
      }
      sequence {
        frame 0 {
          Build Array("AM", "PM") -> w23
          Quotient And Remainder(x=w4, y=12) -> (floor(x/y)=w24)
          # AM or PM
          Array Index(array=w23) -> (out0[w24]=w25)
        }
      }
      sequence {
        frame 0 {
          Concatenate Strings(w18, " ", w20, ":", w22, " ", w25) -> w26
          # Time
          $Time <- w26
        }
      }
    }
  }
  $"Error Out" <- $"Error In"
