vi "test.gvi"   [LabVIEW NXG 3.1.0]
diagram:
  while {
    Get Current Time() -> (current time=w1)
    Get Date And Time String(date format (0)="short", time stamp=w1, want seconds? (F)=FALSE) -> (date string=w2, time string=w3)
    Property Node(instance in=reference to unnamed text, "Text"=w2)
    Property Node(instance in=reference to unnamed text, "Text"=w3)
    Timestamp To Date Time(time stamp=w1) -> (date time rec=w4)
    Property Node(instance in=w4)
    stop if FALSE
  }
